# Grasshopper definition Twist.ghx (Grasshopper 1.0.8)

# ---- group: Inputs
number_slider = Slider(0, range=0..10)

# ----
geomin = Geometry(<extrusion referenced from the Rhino model>)
volume = Volume(Geometry=geomin)  # -> Volume, Centroid
Z = UnitZ(Factor=1)
move = Move(Geometry=volume.Centroid, Motion=Z)  # -> Geometry, Transform
rad = Radians(Degrees=number_slider)
ln = Line(StartPoint=volume.Centroid, EndPoint=move.Geometry)
twist = Twist(Geometry=geomin, Axis=ln, Angle=rad, Infinite=True, Rigid=False)

# ---- group: Outputs
num = Number(rad)
geomout = Geometry(twist)
